# Dynamo graph WORKSHOP_FRAMING.dyn (Dynamo 2.0.2.6826)

python_csv_create = Python()  # empty script
python_update_structural_framing = Python()  # unwired: IN[0]; empty script
python_csv_update = Python()  # empty script
python_graphic_override = Python()  # unwired: IN[0]; empty script
fill_patterns = FillPatterns(index=1)
python_move_elements = Python()  # empty script
python_create_sheets = Python()  # unwired: IN[0]; empty script
family_types = FamilyTypes(index=15)
python_rotate_elements = Python()  # empty script
python_apply_view_template = Python()  # empty script
python_get_linked_document = Python()  # empty script
python_create_structural_framing = Python()  # unwired: IN[0]; empty script
watch = Watch(python_create_structural_framing)
